% Simulink data dictionary Control_data.sldd
% references SAL_sensor_data.sldd
% references Seeker_detect_data.sldd
% references Dynamic_data.sldd

PN_results_bus = Simulink.Bus()
  LOS_rate_Z: double
  Dynamic_N: double
  Seeker_Power_Rate: double
  LOS_Rate_Y: double

Control_output_bus = Simulink.Bus()
  Output_Y_Axis: double
  Output_Z_Axis: double

Control_results_bus = Simulink.Bus()
  Output_YZ: double[2]
  Control_Case: double
  PN_results: Bus: PN_results_bus

Control_phasing_power_threshold = 0.0022
Phasing_switch = 0
Control_switch = 1
Pure_Pursuit_Z_Gain = 4000
Pure_Pursuit_Y_Gain = 0
Pure_Pursuit_Centered_angle_Z = 0.087
Ref_speed = 250
Nav_constant = 3
Dynamic_Navigation_constant = 0
Dynamic_Nav_Gain = 0.4
Control_saturation_power_threshold = 0.2
Control_Force_Limit = 2000