% Simulink data dictionary Designator_Sim_data.sldd

Designator_bus = Simulink.Bus()
  r_ind_global: double[3,d_raycount]
  Ray_Power_init: double

d_geo = [0; 0; 0]
d_raycount = 10000
d_divergence = 0.0003
d_pulse_energy = 0.08
d_pulse_frequency = 20
d_pulse_duration = 1.5e-8
d_efficiency = 0.95
d_h_error = -4.33592e-05
d_v_error = 3.426245e-05
sal_atmos_coef = 0.0001