% Simulink data dictionary Seeker_detect_data.sldd
% references Designator_Sim_data.sldd
% references Ray_tracing_hit_data.sldd
% references Target_Sim_data.sldd

s_orientation = [0 -0.7796]

Impact_Seeker_Bus = Simulink.Bus()
  Impact_Seeker_Number: double
  Impact_Seeker_List: double[6,d_raycount]
  Impact_Seeker_Total_Power: double

s_fov = 0.1745329
s_aperture_diameter = 0.06
s_efficiency = 0.85
s_energy_threshold = 0.00025
s_focal_distance = 0.06
s_defocus = 0.005