% Simulink data dictionary Target_Sim_data.sldd

Target_bus = Simulink.Bus()
  Rot_matrix_target: double[3 3]
  Surface_center_global: double[3 6]
  Left_edge_center_global: double[3 6]
  Top_edge_center_global: double[3 6]

t_geo = [2537.05 -4.590548e-14 0.02099704]
t_rotation = 0
t_size = [6.4 2.3 2.3]
t_reflect = repmat(0.4, 1, 6)